vi "Keynote Tag Example.gvi"   [Next Generation LabVIEW Features 0.1.0]
panel controls:
  "stop": bool
panel indicators:
  "Weaveform": f64[]  # Returns the output signal formatted as dynamic data.
  "double": f64
  "Iteration": i32
  "Average": f64
  "Votes": i32
uses:
  NI::Analysis::Generation::Basic Function Generator.gvi
diagram:
  call "Open Tag.gvi"(tag path="modulation") -> (tag reference out=w1, error out=w2)
  Property Node(instance in=w1, "Collect Aggregates_4"=TRUE, error in=w2) -> (error out=w3, instance out=w4)
  call "Create Tag (Double).gvi"(tag reference in=w4, error in=w3) -> (tag reference out=w5, error out=w6)
  call "Write Double Tag.gvi"(tag reference in=w5, error in=w6, double=1) -> (tag reference out=w7)
  call "Reset Aggregates (Single).gvi"(tag reference in=w7) -> (tag reference out=w8, error out=w9)
  call "Open Tag.gvi"(tag path="waveform", error in=w9) -> (tag reference out=w10, error out=w11)
  call "Create Tag (String).gvi"(tag reference in=w10, error in=w11) -> (tag reference out=w12, error out=w13)
  while (iteration -> i1) {
    Wait Until Next Multiple(multiple to wait=1000)
    $Iteration <- i1
    call "Read Double Values.gvi"(tag reference in=w8, error in=w13) -> (error out=w14, double=w15, aggregate values=w16)
    Property Node(instance in=w16) -> ("mean"=w17, "count"=w18)
    Multiply(w17, 10) -> w19
    call "Basic Function Generator.gvi"(amplitude=1, frequency=w19, reset phase=FALSE, square wave duty cycle=50, error in=w14, signal type="Sine Wave", phase in=0, offset=0) -> (signal=w20, error out=w21)
    Property Node(instance in=w20) -> ("Y"=w22)
    Flatten To JSON(anything=w22, error in (no error)=w21) -> (JSON string=w23, error out=w24)
    call "Write String Tag.gvi"(tag reference in=w12, error in=w24, string=w23) -> (error out=w25)
    $Average <- w17
    $Weaveform <- w22
    $Votes <- w18
    $double <- w15
    stop if $stop
  }
