vi "Function_2.gvi"   [Next Generation LabVIEW Features 0.1.0]
inputs:
  "output waveform": waveform<f64> = {dt=1, Y=[]}
  "Pitch Ratio": f64
  "Frame Size": i32 = 512
  "Overlap": i32 = 32
outputs:
  "Waveform_3": waveform<f64>
  "Array": waveform<f64>[]
diagram:
  call "Pitch Change.gvi"(Waveform in=$"output waveform", Frame size=$"Frame Size", Overlap=$Overlap, PitchRatio=$"Pitch Ratio") -> (Waveform out=w1)
  $Waveform_3 <- w1
  Build Array(w1) -> w2
  $Array <- w2
