vi "Keynote Dashboard with DAQ.gvi"   [Next Generation LabVIEW Features 0.1.0]
panel controls:
  "stop": bool
  "Power Button": bool
  "Slider": f64
panel indicators:
  "Low": f64
  "High": f64
  "Graph": waveform<f64>
  "Responses": f64
  "Intensity Graph": f64[][]
  "Error": error
types:
  "Sound Data Format.gtype" = cluster{"sample rate (S/s)": f64, "number of channels": i32, "bits per sample": i32}
uses:
  NI::Analysis::Measurement::STFT Spectrogram.gvi
diagram:
  call "DAQmx Create Task.gvi"() -> (error out=w1, task out=w2)
  call "DAQmx Create Channel (AI-Voltage-Basic).gvi"(error in=w1, task in=w2, physical channels="myDAQ1/audioInputLeft", maximum value=1, minimum value=-1) -> (error out=w3, task out=w4)
  call "DAQmx Timing (Sample Clock).gvi"(error in=w3, task in=w4, rate=22000, sample mode="Continuous Samples"(10123), samples per channel=2048) -> (error out=w5, task out=w6)
  w7 = "Sound Data Format.gtype" {"sample rate (S/s)"=22000, "number of channels"=2, "bits per sample"=16}
  call "Sound Output Configure.gvi"(sound format=w7, number of samples/ch=2048) -> (task ID=w8, error out=w9)
  s1 = w9  # shift register
  s2 = w8  # shift register
  while {
    call "Read Tags.gvi"() -> (High=w10, Low=w11, Pitch Ratio=w12, Responses=w13)
    $Responses <- w13
    $High <- w10
    call "DAQmx Read (Analog Wfm 1Chan NSamp).gvi"(error in=w5, task in=w6, number of samples per channel=2048) -> (data=w14)
    case ($"Power Button") {
      frame False, Default {
        Build Array(w14) -> w16
        w15 = w14
      }
      frame True {
        call "Pitch Change.gvi"(Waveform in=w14, PitchRatio=$Slider) -> (Array of Waveform=w16, Waveform out=w15)
      }
    }
    call "Write Waveform Tag.gvi"(Waveform=w15)
    $Low <- w11
    $Graph <- w15
    call "STFT Spectrogram.gvi"(x=w15) -> (STFT spectrogram=w17)
    $"Intensity Graph" <- w17
    call "Sound Output Write.gvi"(task ID in=s2, data=w16, error in=s1) -> (task ID out=w18, error out=w19)
    Logical Or(w19, $stop) -> w20
    next s1 = w19
    next s2 = w18
    stop if w20
  }
  $Error <- s1
