vi "Keynote Sound File Close.gvi"   [LabVIEW Conversion 4.7.1.34468]
# Closes a .wav file.
inputs:
  "sound file refnum": "Keynote Sound File Refnum.gtype", required  # sound file refnum is the reference to the sound file.
  "error in (no error)": error
outputs:
  "error out": error
types:
  "Keynote Sound File Refnum.gtype" = ByteStreamFileRefnum
uses:
  lvsound2.sli::SoundFileClose
diagram:
  Type Cast(type=i32 0, x=$"sound file refnum") -> w1
  call "SoundFileClose"(ref in=w1) -> (return=w2)
  case (w2) {
    frame 4801 {
      # ignore invalid refnum error
      w3 = $"error in (no error)"
    }
    frame Default {
      call "Keynote _Get Sound Error From Return Value.gvi"(Error Code=w2) -> (error out=w4)
      Merge Errors($"error in (no error)", w4) -> (error out=w3)
    }
  }
  $"error out" <- w3
