vi "Keynote Sound File Info (path).gvi"   [LabVIEW Conversion 4.7.1.34468]
# Retrieves data about a .wav file. This VI accepts either a path or a refnum.
inputs:
  "path": path, required  # path specifies the absolute path to the wave file.
  "error in (no error)": error
outputs:
  "path out": path  # path out identifies the wave file passed in path.
  "total number of samples/ch": u32  # total number of samples/ch returns the total number of samples per channel in the wave file.
  "sound format": "Keynote Sound Data Format.gtype"  # sound format returns the sample rate, the number of channels, and the number of bits per sample in the wave file.
  "error out": error
types:
  "Keynote Sound Data Format.gtype" = cluster{"sample rate (S/s)": f64, "number of channels": i32, "bits per sample": i32}
diagram:
  $"path out" <- $path
  call "Keynote Sound File Read Open.gvi"(path=$path, error in (no error)=$"error in (no error)") -> (sound file refnum=w1, error out=w2)
  call "Keynote Sound File Info (refnum).gvi"(sound file refnum=w1, error in (no error)=w2) -> (sound file refnum out=w3, total number of samples/ch=w4, sound format=w5, error out=w6)
  call "Keynote Sound File Close.gvi"(sound file refnum=w3, error in (no error)=w6) -> (error out=w7)
  $"error out" <- w7
  $"total number of samples/ch" <- w4
  $"sound format" <- w5
