vi "Keynote Sound File Info (refnum).gvi"   [LabVIEW Conversion 4.7.1.34468]
# Retrieves data about a .wav file. This VI accepts either a path or a refnum.
inputs:
  "sound file refnum": "Keynote Sound File Refnum.gtype", required  # sound file refnum is the reference to the sound file.
  "error in (no error)": error
outputs:
  "sound file refnum out": "Keynote Sound File Refnum.gtype"  # sound file refnum out is the reference to the sound file originally passed in the sound file refnum parameter.
  "total number of samples/ch": u32  # total number of samples/ch returns the total number of samples per channel in the wave file.
  "sound format": "Keynote Sound Data Format.gtype"  # sound format returns the sample rate, the number of channels, and the number of bits per sample in the wave file.
  "error out": error
panel indicators:
  "duration": f64  # Total duration, in seconds, of the file.
types:
  "Keynote Sound File Refnum.gtype" = ByteStreamFileRefnum
  "Keynote Sound Data Format.gtype" = cluster{"sample rate (S/s)": f64, "number of channels": i32, "bits per sample": i32}
uses:
  lvsound2.sli::SoundFileInfoRef
diagram:
  $"sound file refnum out" <- $"sound file refnum"
  case ($"error in (no error)") {
    frame No Error {
      Type Cast(type=i32 0, x=$"sound file refnum") -> w5
      call "SoundFileInfoRef"(ref in=w5, format in="", rate in=0, nchannels in=0, bitsPerSample in=0, duration in=0, totalSamples in=0) -> (return=w6, rate out=w7, nchannels out=w8, bitsPerSample out=w9, duration out=w3, totalSamples out=w4)
      call "Keynote _Get Sound Error From Return Value.gvi"(Error Code=w6) -> (error out=w1)
      w10 = "Keynote Sound Data Format.gtype" {"sample rate (S/s)"=11025, "number of channels"=2, "bits per sample"=16}
      Property Node(instance in=w10, "sample rate (S/s)"=w7, "number of channels"=w8, "bits per sample"=w9) -> (instance out=w2)
    }
    frame Error {
      w1 = $"error in (no error)"
      w2 = "Keynote Sound Data Format.gtype" {all zero or empty}
      w3 = 0
      w4 = 0
    }
  }
  $"error out" <- w1
  $"sound format" <- w2
  $duration <- w3
  $"total number of samples/ch" <- w4
