vi "Keynote Sound File Read (I32).gvi"   [LabVIEW Conversion 4.7.1.34468]
# Reads data from a .wav file into an array of waveforms. You must manually select the polymorphic instance you want to use.
inputs:
  "sound file refnum": "Keynote Sound File Refnum.gtype", required  # sound file refnum is the reference to the sound file.
  "position mode": "Keynote Sound File Position.gtype" = "Relative"(2)  # position mode, together with position offset, specifies where the read operation begins.
  "position offset": i32  # position offset specifies how far from the location specified by position mode to start reading.
  "error in (no error)": error
  "number of samples/ch (-1: all)": i32 = -1  # number of samples/ch specifies the number of samples per channel to read from the file. -1 specifies all samples.
outputs:
  "sound file refnum out": "Keynote Sound File Refnum.gtype"  # sound file refnum out is the reference to the sound file originally passed in the sound file refnum parameter.
  "data": waveform<f64>[]  # data reads any sound data from the file. For multi-channel sound data, data is an array of waveforms where each element of the array is a single channel.
  "offset": i32  # offset indicates the new location of the file mark relative to the beginning of the file, in units of samples.
  "error out": error
  "end of file?": bool  # end of file? returns TRUE when the VI reaches the end of the file.
types:
  "Keynote Sound File Refnum.gtype" = ByteStreamFileRefnum
  "Keynote Sound File Position.gtype" = u16
uses:
  lvsound2.sli::SoundReadFileSamplesRead
  lvsound2.sli::SoundReadFileData_3
diagram:
  $"sound file refnum out" <- $"sound file refnum"
  call "Keynote Sound File Info (refnum).gvi"(sound file refnum=$"sound file refnum", error in (no error)=$"error in (no error)") -> (sound file refnum out=w1, sound format=w2, error out=w3)
  case (w3) {
    frame No Error {
      Type Cast(type=i32 0, x=w1) -> w8
      call "SoundReadFileSamplesRead"(ref in=w8) -> (ref out=w9, samplesRead out=w10)
      call "SoundReadFileData_3"(ref in=w9, posMode in=$"position mode", offset in=$"position offset", nSamples in=$"number of samples/ch (-1: all)", typeCode in=3, sigBits in=16, data in=i32[][] [], samplesRead in=0, eof in=FALSE) -> (return=w11, data out=w12, samplesRead out=w13, eof out=w5)
      call "Keynote _Get Sound Error From Return Value.gvi"(Error Code=w11) -> (error out=w4)
      Property Node(instance in=w2) -> ("sample rate (S/s)"=w14)
      Divide(x=w10, y=w14) -> w15
      To Time Stamp(number=w15) -> w16
      call "Keynote _2DArrToArrWfms.gvi"(I32 Y=w12, t0=w16, rate=w14) -> (data I32=w6)
      Add(w13, $"position offset") -> w7
    }
    frame Error {
      w4 = w3
      w5 = FALSE
      w6 = default
      w7 = 0
    }
  }
  $"error out" <- w4
  $data <- w6
  $"end of file?" <- w5
  $offset <- w7
