vi "Keynote Sound File Read Open.gvi"   [LabVIEW Conversion 4.7.1.34468]
# Opens a .wav file for reading or creates a new .wav file for writing. You must manually select the polymorphic instance you want to use.
inputs:
  "path": path, required  # path specifies the absolute path to the wave file.
  "error in (no error)": error
outputs:
  "sound file refnum": "Keynote Sound File Refnum.gtype"  # sound file refnum returns a reference to the sound file. You can pass sound file refnum to other Sound Files VIs.
  "error out": error
types:
  "Keynote Sound File Refnum.gtype" = ByteStreamFileRefnum
uses:
  lvsound2.sli::SoundReadFileOpen
diagram:
  case ($"error in (no error)") {
    frame No Error {
      call "Keynote Path To Command Line String.gvi"(path=$path) -> (string=w3)
      call "SoundReadFileOpen"(fileName in=w3) -> (return=w4, ref out=w5)
      call "Keynote _Get Sound Error From Return Value.gvi"(Error Code=w4) -> (error out=w1)
      Type Cast(type="Keynote Sound File Refnum.gtype" constant, x=w5) -> w2
    }
    frame Error {
      w1 = $"error in (no error)"
      w2 = Not A Refnum
    }
  }
  $"error out" <- w1
  $"sound file refnum" <- w2
