vi "Keynote Sound File Write (DBL).gvi"   [LabVIEW Conversion 4.7.1.34468]
# Writes data from a waveform or an array of waveforms to a .wav file.
inputs:
  "sound file refnum": "Keynote Sound File Refnum.gtype", required  # sound file refnum is the reference to the sound file.
  "data": waveform<f64>[]  # data writes any sound data to the internal buffers. For multi-channel sound data, data is an array of waveforms where each element of the array is a single channel.
  "error in (no error)": error
outputs:
  "sound file refnum out": "Keynote Sound File Refnum.gtype"  # sound file refnum out is the reference to the sound file originally passed in the sound file refnum parameter.
  "error out": error
types:
  "Keynote Sound File Refnum.gtype" = ByteStreamFileRefnum
uses:
  lvsound2.sli::SoundWriteFileData
diagram:
  $"sound file refnum out" <- $"sound file refnum"
  case ($"error in (no error)") {
    frame No Error {
      call "Keynote _ArrWfmsTo2DArr.gvi"(data DBL=$data) -> (DBL Y=w2)
      Type Cast(type=i32 0, x=$"sound file refnum") -> w3
      call "SoundWriteFileData"(refnum in=w3, data in=w2, samplesRead in=0, typeCode in=10) -> (return=w4)
      call "Keynote _Get Sound Error From Return Value.gvi"(Error Code=w4) -> (error out=w1)
    }
    frame Error {
      w1 = $"error in (no error)"
    }
  }
  $"error out" <- w1
