vi "Keynote Sound File Write Open.gvi"   [LabVIEW Conversion 4.7.1.34468]
# Opens a .wav file for reading or creates a new .wav file for writing. You must manually select the polymorphic instance you want to use.
inputs:
  "path": path, required  # path specifies the absolute path to the wave file.
  "sound format": "Keynote Sound Data Format.gtype" = {"sample rate (S/s)"=22050, "number of channels"=2, "bits per sample"=16}  # sound format sets the sample rate, the number of channels, and the bits per sample for the wave file. The values for each of these controls is dependent on your sound card.
  "error in (no error)": error
outputs:
  "sound file refnum": "Keynote Sound File Refnum.gtype"  # sound file refnum returns a reference to the sound file. You can pass sound file refnum to other Sound Files VIs.
  "error out": error
types:
  "Keynote Sound File Refnum.gtype" = ByteStreamFileRefnum
  "Keynote Sound Data Format.gtype" = cluster{"sample rate (S/s)": f64, "number of channels": i32, "bits per sample": i32}
uses:
  lvsound2.sli::SoundWriteFileOpen
diagram:
  case ($"error in (no error)") {
    frame No Error {
      call "Keynote Path To Command Line String.gvi"(path=$path) -> (string=w3)
      Property Node(instance in=$"sound format") -> ("sample rate (S/s)"=w4, "number of channels"=w5, "bits per sample"=w6)
      call "SoundWriteFileOpen"(fileName in=w3, rate in=w4, nChannels in=w5, bitDepth in=w6, formatStr in="") -> (return=w7, ref out=w8)
      call "Keynote _Get Sound Error From Return Value.gvi"(Error Code=w7) -> (error out=w1)
      Type Cast(type="Keynote Sound File Refnum.gtype" constant, x=w8) -> w2
    }
    frame Error {
      w1 = $"error in (no error)"
      w2 = Not A Refnum
    }
  }
  $"error out" <- w1
  $"sound file refnum" <- w2
