vi "Keynote Sound File Write Simple.gvi"   [LabVIEW Conversion 4.7.1.34468]
# Writes data from an array of waveforms to a .wav file. This VI automatically opens, writes to, and closes the .wav file.
inputs:
  "path": path, required  # path specifies the absolute path to the wave file.
  "data": waveform<f64>[]  # data writes any sound data to the internal buffers. For multi-channel sound data, data is an array of waveforms where each element of the array is a single channel.
  "bits per sample": i32 = 16  # bits per sample specifies the quality of each sample in bits. Common resolutions are 16 bits and 8 bits. The default is 16 bits.
  "error in (no error)": error
outputs:
  "path out": path  # path out identifies the wave file passed in path.
  "error out": error
types:
  T1 = cluster{"rate": f64, "channels": i32, "bits per sample": i32}
diagram:
  $"path out" <- $path
  case ($"error in (no error)") {
    frame No Error {
      call "Keynote _FormatFromData (DBL).gvi"(data=$data) -> (rate=w2, channels=w3)
      Property Node(instance in=T1 {all zero or empty}, "rate"=w2, "channels"=w3, "bits per sample"=$"bits per sample") -> (instance out=w4)
      call "Keynote Sound File Write Open.gvi"(path=$path, sound format=w4, error in (no error)=$"error in (no error)") -> (sound file refnum=w5, error out=w6)
      call "Keynote Sound File Write (DBL).gvi"(sound file refnum=w5, data=$data, error in (no error)=w6) -> (sound file refnum out=w7, error out=w8)
      call "Keynote Sound File Close.gvi"(sound file refnum=w7, error in (no error)=w8) -> (error out=w1)
    }
    frame Error {
      w1 = $"error in (no error)"
    }
  }
  $"error out" <- w1
