vi "Keynote Sound Output Clear.gvi"   [LabVIEW Conversion 4.7.1.34468]
# Stops the device from playing sound, clears the buffer, returns the task to the default state, and clears the resources associated with the task. The task becomes invalid.
inputs:
  "task ID": "Keynote Sound Output Task ID.gtype", required  # task ID is the sound operation from the configured device you want to manipulate or input.
  "error in (no error)": error
outputs:
  "error out": error
types:
  "Keynote Sound Output Task ID.gtype" = u32
uses:
  lvsound2.sli::SOClear
diagram:
  call "SOClear"(taskID in=$"task ID") -> (return=w1)
  call "Keynote _Get Sound Error From Return Value.gvi"(Error Code=w1) -> (error out=w2)
  Merge Errors($"error in (no error)", w2) -> (error out=w3)
  $"error out" <- w3
