vi "Keynote Sound Output Configure.gvi"   [LabVIEW Conversion 4.7.1.34468]
# Configures a sound output device to generate data. Use the Sound Output Write VI to write the data to the device.
inputs:
  "device ID": u32  # device ID is the input or output device you access for a sound operation. In general, most users should select the default value of 0.
  "sound format": "Keynote Sound Data Format.gtype" = {"sample rate (S/s)"=22050, "number of channels"=2, "bits per sample"=16}  # sound format sets the playing rate, the number of channels, and the bits per sample of the sound operation. The values for each of these controls is dependent on your sound card.
  "error in (no error)": error
  "sample mode": "Keynote Sampling Mode.gtype" = "Continuous Samples"(1)  # sample mode specifies whether you intend to write just once (Finite Samples) or continuously (Continuous Samples).
  "number of samples/ch": i32 = 100000  # number of samples/ch specifies the number of samples per channel in the buffer.
outputs:
  "task ID": "Keynote Sound Output Task ID.gtype"  # task ID returns an identification number associated with the configuration on the specified device. You can pass task ID to other sound operation VIs.
  "error out": error
panel indicators:
  "resulting sound format": "Keynote Sound Data Format.gtype"
types:
  "Keynote Sound Output Task ID.gtype" = u32
  "Keynote Sampling Mode.gtype" = i32
  "Keynote Sound Data Format.gtype" = cluster{"sample rate (S/s)": f64, "number of channels": i32, "bits per sample": i32}
  T1 = cluster{"rate": f64, "nChannels": i32, "bitDepth": i32}
uses:
  lvsound2.sli::SOConfigure
diagram:
  case ($"error in (no error)") {
    frame No Error {
      Property Node(instance in=$"sound format") -> ("sample rate (S/s)"=w4, "number of channels"=w5, "bits per sample"=w6)
      call "SOConfigure"(device in=$"device ID", nSamples in=$"number of samples/ch", rate in=w4, nChannels in=w5, bitDepth in=w6, mode in=$"sample mode", task in=0) -> (return=w7, rate out=w8, nChannels out=w9, bitDepth out=w10, task out=w3)
      call "Keynote _Get Sound Error From Return Value.gvi"(Error Code=w7) -> (error out=w1)
      Property Node(instance in=T1 {all zero or empty}, "rate"=w8, "nChannels"=w9, "bitDepth"=w10) -> (instance out=w2)
    }
    frame Error {
      w1 = $"error in (no error)"
      w2 = T1 {all zero or empty}
      w3 = 0
    }
  }
  $"error out" <- w1
  $"resulting sound format" <- w2
  $"task ID" <- w3
