vi "Keynote Sound Output Wait.gvi"   [LabVIEW Conversion 4.7.1.34468]
# Waits until all of the sound is played by the output device.
inputs:
  "task ID": "Keynote Sound Output Task ID.gtype", required  # task ID is the sound operation from the configured device you want to manipulate or input.
  "error in (no error)": error
  "timeout (sec)": f64 = 10  # timeout (sec) specifies the time, in seconds, that the VI waits for the sound operation to complete.
outputs:
  "task ID out": "Keynote Sound Output Task ID.gtype"  # task ID out is the manipulated sound operation originally passed to the task ID parameter.
  "error out": error
types:
  "Keynote Sound Output Task ID.gtype" = u32
uses:
  lvsound2.sli::SOWait
diagram:
  $"task ID out" <- $"task ID"
  case ($"error in (no error)") {
    frame No Error {
      call "SOWait"(taskID in=$"task ID", timeout in=$"timeout (sec)") -> (return=w2)
      call "Keynote _Get Sound Error From Return Value.gvi"(Error Code=w2) -> (error out=w1)
    }
    frame Error {
      w1 = $"error in (no error)"
    }
  }
  $"error out" <- w1
