vi "Keynote Sound Output Write (DBL Single).gvi"   [LabVIEW Conversion 4.7.1.34468]
# Writes data to a sound output device. You must use the Sound Output Configure VI to configure the device if you are writing continuously. You must manually select the polymorphic instance you want to use.
inputs:
  "task ID": "Keynote Sound Output Task ID.gtype", required  # task ID is the sound operation from the configured device you want to manipulate or input.
  "data": waveform<f64> = {dt=1, Y=[]}  # data writes any sound data to the internal buffers.
  "error in (no error)": error
  "timeout (sec)": f64 = 10  # timeout (sec) specifies the time, in seconds, that the function waits for the sound operation to complete.
outputs:
  "task ID out": "Keynote Sound Output Task ID.gtype"  # task ID out is the manipulated sound operation originally passed to the task ID parameter.
  "error out": error
types:
  "Keynote Sound Output Task ID.gtype" = u32
diagram:
  Build Array($data) -> w1
  call "Keynote Sound Output Write (DBL).gvi"(task ID=$"task ID", data=w1, error in (no error)=$"error in (no error)", timeout (sec)=$"timeout (sec)") -> (task ID out=w2, error out=w3)
  $"task ID out" <- w2
  $"error out" <- w3
