vi "Keynote Sound Output Write (I32).gvi"   [LabVIEW Conversion 4.7.1.34468]
# Writes data to a sound output device. You must use the Sound Output Configure VI to configure the device if you are writing continuously. You must manually select the polymorphic instance you want to use.
inputs:
  "task ID": "Keynote Sound Output Task ID.gtype", required  # task ID is the sound operation from the configured device you want to manipulate or input.
  "data": waveform<f64>[]  # data writes any sound data to the internal buffers. For multi-channel sound data, data is an array of waveforms where each element of the array is a single channel.
  "error in (no error)": error
  "timeout (sec)": f64 = 10  # timeout (sec) specifies the time, in seconds, that the function waits for the sound operation to complete.
outputs:
  "task ID out": "Keynote Sound Output Task ID.gtype"  # task ID out is the manipulated sound operation originally passed to the task ID parameter.
  "error out": error
types:
  "Keynote Sound Output Task ID.gtype" = u32
uses:
  lvsound2.sli::SOWrite_3
diagram:
  $"task ID out" <- $"task ID"
  case ($"error in (no error)") {
    frame No Error {
      call "Keynote _ArrWfmsTo2DArr.gvi"(data I32=$data) -> (I32 Y=w2)
      call "SOWrite_3"(taskID in=$"task ID", data in=w2, timeout in=$"timeout (sec)", typeCode in=3) -> (return=w3)
      call "Keynote _Get Sound Error From Return Value.gvi"(Error Code=w3) -> (error out=w1)
    }
    frame Error {
      w1 = $"error in (no error)"
    }
  }
  $"error out" <- w1
