vi "Keynote 2D Complex FFT.gvi"   [LabVIEW Conversion 4.7.1.34468]
# Computes the fast Fourier transform (FFT) of the input sequence X. Wire data to the X input to determine the polymorphic instance to use or manually select the instance.
inputs:
  "X": c128[][]  # X is the complex valued input sequence.
  "shift?": bool  # shift? specifies whether the DC component is at the center of FFT {X}. The default is FALSE.
  "m": i32 = -1  # m specifies the number of rows of the 2D FFT. This VI truncates or zero-pads X to an m-by-n array before performing the FFT.
  "n": i32 = -1  # n specifies the number of columns of the 2D FFT. This VI truncates or zero-pads X to an m-by-n array before performing the FFT.
outputs:
  "FFT {X}": c128[][]  # FFT {X} is the 2D FFT of X.
  "error": i32  # error returns any error or warning from the VI. You can wire error to the Error Cluster From Error Code VI to convert the error code or warning into an error cluster.
uses:
  lvanlys.sli::CxFFT2D_H_IDP
diagram:
  Boolean To Integer(Boolean=$"shift?") -> (0, 1=w1)
  Is Less Or Equal To 0(x=$n) -> w2
  Array Size(array=$X) -> (size(s)=w3)
  Array Index(array=w3) -> (out0[_]=w4, out1[_]=w5)
  Select(s=w2, t=w5, f=$n) -> w6
  Is Less Or Equal To 0(x=$m) -> w7
  Select(s=w7, t=w4, f=$m) -> w8
  call "CxFFT2D_H_IDP"(xH in=$X, orgRow in=0, orgCol in=0, rowsFFT in=w8, colsFFT in=w6, shift in=w1, yH in=c128[][] []) -> (return type=w9, yH out=w10)
  $error <- w9
  $"FFT {X}" <- w10
