vi "Keynote 2D Inverse Complex FFT.gvi"   [LabVIEW Conversion 4.7.1.34468]
# Computes the inverse discrete Fourier transform (IDFT) of the input sequence FFT {X}. You must manually select the polymorphic instance you want to use.
inputs:
  "FFT {x}": c128[][]  # FFT {X} is the complex valued input sequence.
  "shift?": bool  # shift? specifies whether the DC component is at the center of FFT {X}. The default is FALSE.
outputs:
  "X": c128[][]  # X is the inverse complex FFT of FFT {X}.
  "error": i32  # error returns any error or warning from the VI. You can wire error to the Error Cluster From Error Code VI to convert the error code or warning into an error cluster.
uses:
  lvanlys.sli::CxInvFFT2D_H_IDP
diagram:
  Boolean To Integer(Boolean=$"shift?") -> (0, 1=w1)
  call "CxInvFFT2D_H_IDP"(xH in=$"FFT {x}", shifted in=w1, yH in=c128[][] []) -> (return type=w2, yH out=w3)
  $error <- w2
  $X <- w3
