vi "Keynote Complex FFT.gvi"   [LabVIEW Conversion 4.7.1.34468]
# Computes the fast Fourier transform (FFT) of the input sequence X. Wire data to the X input to determine the polymorphic instance to use or manually select the instance.
inputs:
  "X": c128[]  # X is the complex valued input sequence.
  "shift?": bool  # shift? specifies whether the DC component is at the center of FFT {X}. The default is FALSE.
  "FFT size": i32 = -1  # FFT size is the length of the FFT you want to perform.
outputs:
  "FFT {X}": c128[]  # FFT {X} is the FFT of X.
  "error": i32  # error returns any error or warning from the VI. You can wire error to the Error Cluster From Error Code VI to convert the error code or warning into an error cluster.
uses:
  lvanlys.sli::CxNIFFTH80_IDP
diagram:
  Boolean To Integer(Boolean=$"shift?") -> (0, 1=w1)
  Array Size(array=$X) -> (size(s)=w2)
  Is Less Or Equal To 0(x=$"FFT size") -> w3
  Select(s=w3, t=w2, f=$"FFT size") -> w4
  call "CxNIFFTH80_IDP"(xH in=$X, yH in=c128[] [], org in=0, fftSize in=w4, shift in=w1) -> (return type=w5, yH out=w6)
  $error <- w5
  $"FFT {X}" <- w6
