vi "Keynote Dashboard with DAQ.gvi"   [Next Generation LabVIEW Features 0.1.0]
panel controls:
  "stop": bool
  "Power Button": bool
  "Slider": f64
panel indicators:
  "Graph": waveform<f64>
  "Intensity Graph": f64[][]
  "Error": error
types:
  "Sound Data Format.gtype" = cluster{"sample rate (S/s)": f64, "number of channels": i32, "bits per sample": i32}
uses:
  NI::Analysis::Measurement::STFT Spectrogram.gvi
diagram:
  call "DAQmx Create Task.gvi"() -> (error out=w1, task out=w2)
  call "DAQmx Create Channel (AI-Voltage-Basic).gvi"(error in=w1, task in=w2, physical channels="cDAQ2Mod1/ai0", maximum value=1, minimum value=-1) -> (error out=w3, task out=w4)
  call "DAQmx Timing (Sample Clock).gvi"(error in=w3, task in=w4, rate=25600, sample mode="Continuous Samples"(10123), samples per channel=4096) -> (error out=w5, task out=w6)
  w7 = "Sound Data Format.gtype" {"sample rate (S/s)"=25600, "number of channels"=2, "bits per sample"=16}
  call "Sound Output Configure.gvi"(sound format=w7, number of samples/ch=4096) -> (task ID=w8, error out=w9)
  s1 = w9  # shift register
  s2 = w8  # shift register
  while {
    call "DAQmx Read (Analog Wfm 1Chan NSamp).gvi"(error in=w5, task in=w6, number of samples per channel=4096) -> (data=w10)
    case ($"Power Button") {
      frame False, Default {
        Build Array(w10) -> w12
        w11 = w10
      }
      frame True {
        call "Pitch Change.gvi"(Waveform in=w10, PitchRatio=$Slider) -> (Array of Waveform=w12, Waveform out=w11)
      }
    }
    $Graph <- w11
    call "STFT Spectrogram.gvi"(x=w11) -> (STFT spectrogram=w13)
    $"Intensity Graph" <- w13
    call "Sound Output Write.gvi"(task ID in=s2, data=w12, error in=s1) -> (task ID out=w14, error out=w15)
    Logical Or(w15, $stop) -> w16
    next s1 = w15
    next s2 = w14
    stop if w16
  }
  $Error <- s1
