vi "Keynote Path To Command Line String.gvi"   [LabVIEW Conversion 4.7.1.34468]
inputs:
  "path": path, required
outputs:
  "string": string
diagram:
  disable {
    frame 0, Default {
      Path To String(path=$path) -> (string=w1)
    }
    frame TARGET_TYPE=="Mac"&&TARGET_BITNESS!=64 {
      call "Keynote PathToUNIXPathString.gvi"(LV Path=$path) -> (UNIX Path=w2, error out=w3)
      case (w3) {
        frame No Error {
          w1 = w2
        }
        frame Error {
          w1 = ""
        }
      }
    }
  }
  $string <- w1
