vi "Keynote Pitch Change - On-the-fly Reset.gvi"   [Next Generation LabVIEW Features 0.1.0]
inputs:
  "Output Accumulator in": f64[]
  "Input Accumulator in": f64[]
  "Input Phase Diff. in": f64[]
  "Main Cluster in": T1
  "PitchRatio in": f64 = 1.4
  "Output Phase Acc. in": f64[]
  "Reset": bool
  "Frame size": i32 = 256
  "Overlap": i32 = 4
outputs:
  "Output Accumulator out": f64[]
  "Input Accumulator out": f64[]
  "Input Phase Diff. out": f64[]
  "Main Cluster out": T1
  "PitchRatio out": f64
  "Output Phase Acc. out": f64[]
types:
  T1 = cluster{"NegStepSize": i32, "StepSizeArray": f64[], "StepSize": i32, "FrameSizeHalf": i32, "FSH+1": i32, "SpectrumArray": c128[], "PhaseOffset": f64[], "MagArray": f64[], "PhiArray": f64[], "IndexArray": i32[], "Hanning": f64[]}
uses:
  NI::Analysis::Generation::Sine Pattern.gvi
diagram:
  s1 = uninitialised  # shift register
  s2 = uninitialised  # shift register
  s3 = uninitialised  # shift register
  s4 = uninitialised  # shift register
  while {
    Is Not Equal(x=$"PitchRatio in", y=s3) -> w1
    Is First Call() -> w2
    Is Not Equal(x=s1, y=$"Frame size") -> w3
    Is Not Equal(x=s2, y=$Overlap) -> w4
    Logical Or(w3, w4) -> w5
    Logical Or(w5, w2, $Reset) -> w6
    case (w6) {
      frame True {
        Initialize Array(element=0, size=$"Frame size") -> w7
        # Framesize2
        Quotient And Remainder(x=$"Frame size", y=2) -> (floor(x/y)=w14)
        Quotient And Remainder(x=$"Frame size", y=$Overlap) -> (floor(x/y)=w15)
        # step size
        Initialize Array(element=0+0i, size=$"Frame size") -> w16
        for (N = w14) (iteration -> i1) {
          append i1 to w17
        }
        Divide(x=6.28318530718, y=$Overlap) -> w18
        Multiply(w18, w17) -> w19
        Subtract(x=3.14159265359, y=w19) -> w20
        call "Sine Pattern.gvi"(samples=$"Frame size", amplitude=0.5, phase=-90) -> (sine pattern=w21)
        # Hanning
        Add(0.5, w21) -> w22
        Negate(x=w15) -> w23
        Increment(x=w14) -> w24
        Divide(x=w17, y=1) -> w25
        To Long Integer(number=w25) -> w26
        Initialize Array(element=0, size=w15) -> w27
        Initialize Array(element=0, size=w14) -> w9
        Property Node(instance in=T1 {all zero or empty}, "NegStepSize"=w23, "StepSizeArray"=w27, "StepSize"=w15, "FrameSizeHalf"=w14, "FSH+1"=w24, "SpectrumArray"=w16, "PhaseOffset"=w20, "MagArray"=w9, "PhiArray"=w9, "IndexArray"=w26, "Hanning"=w22) -> (instance out=w10)
        w8 = w7
        w11 = w9
        w12 = 1
        w13 = TRUE
      }
      frame False {
        case (w1) {
          frame False, Default {
            w10 = $"Main Cluster in"
            w9 = $"Input Phase Diff. in"
            w11 = $"Output Phase Acc. in"
            w12 = $"PitchRatio in"
          }
          frame True {
            # Framesize2
            Quotient And Remainder(x=$"Frame size", y=2) -> (floor(x/y)=w28)
            Initialize Array(element=0, size=w28)
            Property Node(instance in=$"Main Cluster in") -> ("FrameSizeHalf"=w29, "PhiArray"=w30)
            for (N = w29) (iteration -> i2) {
              append i2 to w31
            }
            Divide(x=w31, y=$"PitchRatio in") -> w32
            To Long Integer(number=w32) -> w33
            Property Node(instance in=$"Main Cluster in", "IndexArray"=w33) -> (instance out=w10)
            Multiply(w33, s3) -> w34
            s5 = w30  # shift register
            for (iteration -> i3) {
              w35 = each element of w34
              Is Less Or Equal(x=w35, y=w29) -> w36
              case (w36) {
                frame False, Default {
                  w37 = default
                }
                frame True {
                  Array Index(array=$"Output Phase Acc. in") -> (out0[w35]=w37)
                }
              }
              Replace Array Subset(inArray=s5, index=i3, new=w37) -> w38
              next s5 = w38
            }
            w9 = $"Input Phase Diff. in"
            w11 = s5
            w12 = $"PitchRatio in"
          }
        }
        w7 = $"Output Accumulator in"
        w8 = $"Input Accumulator in"
        w13 = default
      }
    }
    $"Output Accumulator out" <- w7
    $"Input Accumulator out" <- w8
    $"Input Phase Diff. out" <- w9
    $"Output Phase Acc. out" <- w11
    $"Main Cluster out" <- w10
    $"PitchRatio out" <- w12
    next s1 = $"Frame size"
    next s2 = $Overlap
    next s3 = w12
    next s4 = w13
    stop if TRUE
  }
