vi "Keynote _2DArrToArrWfms.gvi"   [LabVIEW Conversion 4.7.1.34468]
inputs:
  "U8 Y": u8[][]
  "I16 Y": i16[][]
  "I32 Y": i32[][]
  "SGL Y": f32[][]
  "DBL Y": f64[][]
  "t0": timestamp
  "rate": f64 = 22050
outputs:
  "data U8": waveform<f64>[]
  "data I16": waveform<f64>[]
  "data I32": waveform<f64>[]
  "data SGL": waveform<f64>[]
  "data DBL": waveform<f64>[]
diagram:
  Reciprocal(x=$rate) -> w1
  for {
    w2 = each element of $"U8 Y"
    Build Waveform Node(Y=w2, dt=w1, t0=$t0) -> (output waveform=w4)
    append w4 to w3
  }
  $"data U8" <- w3
  for {
    w5 = each element of $"I16 Y"
    Build Waveform Node(Y=w5, dt=w1, t0=$t0) -> (output waveform=w7)
    append w7 to w6
  }
  $"data I16" <- w6
  for {
    w8 = each element of $"I32 Y"
    Build Waveform Node(Y=w8, dt=w1, t0=$t0) -> (output waveform=w10)
    append w10 to w9
  }
  $"data I32" <- w9
  for {
    w11 = each element of $"SGL Y"
    Build Waveform Node(Y=w11, dt=w1, t0=$t0) -> (output waveform=w13)
    append w13 to w12
  }
  $"data SGL" <- w12
  for {
    w14 = each element of $"DBL Y"
    Build Waveform Node(Y=w14, dt=w1, t0=$t0) -> (output waveform=w16)
    append w16 to w15
  }
  $"data DBL" <- w15
