vi "Keynote _ArrWfmsTo1DInterleave.gvi"   [LabVIEW Conversion 4.7.1.34468]
inputs:
  "data U8": waveform<f64>[]
  "data I16": waveform<f64>[]
  "data I32": waveform<f64>[]
outputs:
  "U8 Y": u8[]
  "I16 Y": i16[]
  "I32 Y": i32[]
diagram:
  # ONLY WORKS WITH STEREO!!! HACK!
  Array Index(array=$"data U8") -> (out0[_]=w1, out1[_]=w2)
  Property Node(instance in=w1) -> ("Y"=w3)
  Property Node(instance in=w2) -> ("Y"=w4)
  Interleave Array(w3, w4) -> w5
  $"U8 Y" <- w5
  Array Index(array=$"data I16") -> (out0[_]=w6, out1[_]=w7)
  Property Node(instance in=w6) -> ("Y"=w8)
  Property Node(instance in=w7) -> ("Y"=w9)
  Interleave Array(w8, w9) -> w10
  $"I16 Y" <- w10
  Array Index(array=$"data I32") -> (out0[_]=w11, out1[_]=w12)
  Property Node(instance in=w11) -> ("Y"=w13)
  Property Node(instance in=w12) -> ("Y"=w14)
  Interleave Array(w13, w14) -> w15
  $"I32 Y" <- w15
