vi "Keynote _ArrWfmsTo2DArr.gvi"   [LabVIEW Conversion 4.7.1.34468]
inputs:
  "data U8": waveform<f64>[]
  "data I16": waveform<f64>[]
  "data I32": waveform<f64>[]
  "data SGL": waveform<f64>[]
  "data DBL": waveform<f64>[]
outputs:
  "U8 Y": u8[][]
  "I16 Y": i16[][]
  "I32 Y": i32[][]
  "SGL Y": f32[][]
  "DBL Y": f64[][]
diagram:
  for {
    w1 = each element of $"data U8"
    Property Node(instance in=w1) -> ("Y"=w3)
    append w3 to w2
  }
  $"U8 Y" <- w2
  for {
    w4 = each element of $"data I16"
    Property Node(instance in=w4) -> ("Y"=w6)
    append w6 to w5
  }
  $"I16 Y" <- w5
  for {
    w7 = each element of $"data I32"
    Property Node(instance in=w7) -> ("Y"=w9)
    append w9 to w8
  }
  $"I32 Y" <- w8
  for {
    w10 = each element of $"data SGL"
    Property Node(instance in=w10) -> ("Y"=w12)
    append w12 to w11
  }
  $"SGL Y" <- w11
  for {
    w13 = each element of $"data DBL"
    Property Node(instance in=w13) -> ("Y"=w15)
    append w15 to w14
  }
  $"DBL Y" <- w14
