vi "Keynote _FormatFromData (DBL).gvi"   [LabVIEW Conversion 4.7.1.34468]
inputs:
  "data": waveform<f64>[]
outputs:
  "rate": f64
  "channels": i32
  "bits per sample": i32
  "type code": i16
  "samples": i32
diagram:
  $"type code" <- 9
  $"bits per sample" <- 16
  Array Index(array=$data) -> (out0[_]=w1)
  Property Node(instance in=w1) -> ("dt"=w2, "Y"=w3)
  Is Less Or Equal To 0(x=w2) -> w4
  Reciprocal(x=w2) -> w5
  Select(s=w4, t=22050, f=w5) -> w6
  $rate <- w6
  Array Size(array=w3) -> (size(s)=w7)
  $samples <- w7
  Array Size(array=$data) -> (size(s)=w8)
  Is Equal To 0(x=w8) -> w9
  Select(s=w9, t=2, f=w8) -> w10
  $channels <- w10
