vi "Keynote _Get Sound Error From Return Value.gvi"   [LabVIEW Conversion 4.7.1.34468]
inputs:
  "Error Code": i32
outputs:
  "error out": error
diagram:
  case ($"Error Code") {
    frame 0 {
      w1 = no error
    }
    frame 1, Default {
      Call Chain() -> (callchain=w2)
      Array Subset(array=w2, index0=1) -> w3
      Array To Spreadsheet String(array=w3, delimiter="->", format string="%s") -> (spreadsheet string=w4)
      Is Greater Than 0(x=$"Error Code") -> w5
      Property Node(instance in=error {"status"=TRUE, "code"=0, "source"="SoundError"}, "source"=w4, "code"=$"Error Code", "status"=w5) -> (instance out=w1)
    }
  }
  $"error out" <- w1
