vi "Pitch Change - Process Data Chunk 02b (Windows).gvi"   [Next Generation LabVIEW Features 0.1.0]
inputs:
  "Data Chunk in": f64[]
  "Frame size": i32 = 256
  "Overlap": i32 = 4
  "Reset": bool
  "PitchRatio": f64 = 1.4
outputs:
  "Data Chunk out": f64[]
panel controls:
  "Error": error
panel indicators:
  "Waveform Graph": f64[]
  "Error_2": error
uses:
  NI::Analysis::Transforms::Real FFT.gvi
  NI::Analysis::Transforms::Inverse Real FFT.gvi
diagram:
  case ($Error) {
    frame Error { }
    frame No Error {
      s1 = uninitialised  # shift register
      s2 = uninitialised  # shift register
      s3 = uninitialised  # shift register
      s4 = uninitialised  # shift register
      s5 = uninitialised  # shift register
      while {
        call "Pitch Change - On-the-fly Reset.gvi"(Output Accumulator in=s4, Input Accumulator in=s3, Input Phase Diff. in=s1, Main Cluster in=s5, PitchRatio in=$PitchRatio, Output Phase Acc. in=s2, Reset=$Reset, Frame size=$"Frame size", Overlap=$Overlap) -> (Output Accumulator out=w1, Input Accumulator out=w2, Input Phase Diff. out=w3, Main Cluster out=w4, PitchRatio out=w5, Output Phase Acc. out=w6)
        Property Node(instance in=w4) -> ("NegStepSize"=w7, "StepSize"=w8, "PhaseOffset"=w9, "StepSizeArray"=w10, "Hanning"=w11, "FSH+1"=w12, "SpectrumArray"=w13, "MagArray"=w14, "PhiArray"=w15, "FrameSizeHalf"=w16, "IndexArray"=w17)
        Replace Array Subset(inArray=w2, index=_, new=$"Data Chunk in") -> w18
        Rotate 1D Array(array=w18, n=w7) -> (array (last n elements first)=w19)
        Multiply(w19, w11) -> w20
        # 17%
        call "Real FFT.gvi"(x=w20) -> (FFT{x}=w21)
        Array Subset(array=w21, length0=w16) -> w22
        # Indicates approximate CPU use
        # 13%
        Complex To Polar(r * e^(i*theta)=w22) -> (r=w23, theta=w24)
        # Zero array
        # Zero array
        # Zero array
        # Zero array
        Subtract(x=w24, y=w3) -> w25
        Add(w25, w9) -> w26
        # 5%
        # 'Zero array's are used as
        # pre-allocated memory since
        # 'Replace subset' is much
        # faster than 'Build array'.
        # An FPGA implementation
        # would obviously be different
        Quotient And Remainder(x=w26, y=6.28318530718) -> (x-y*floor(x/y)=w27)
        Subtract(x=w27, y=w9) -> w28
        # The 'modulo 2PI' is expensive. An FPGA
        # implementation (Integer) would use
        # 'word-wrap' instead but require a local
        # phase scaling with f.ex 32768/2PI
        s6 = w15  # shift register
        s7 = w14  # shift register
        for (iteration -> i1) {
          w29 = each element of w17
          Is Less Or Equal(x=w29, y=w16) -> w30
          case (w30) {
            frame False, Default {
              w31 = default
              w32 = default
            }
            frame True {
              Array Index(array=w23) -> (out0[w29]=w31)
              Array Index(array=w28) -> (out0[w29]=w32)
            }
          }
          Replace Array Subset(inArray=s7, index=i1, new=w31) -> w33
          Replace Array Subset(inArray=s6, index=i1, new=w32) -> w34
          next s6 = w34
          next s7 = w33
        }
        Multiply(s6, w5) -> w35
        Add(w35, w6) -> w36
        Sine And Cosine(x=w36) -> (cos(x)=w37, sin(x)=w38)
        # 13%
        Multiply(s7, w38) -> w39
        Multiply(w37, s7) -> w40
        Real And Imaginary To Complex(x=w40, y=w39) -> w41
        Replace Array Subset(inArray=w13, index=_, new=w41) -> w42
        Array Subset(array=w41, index0=1) -> w43
        Reverse 1D Array(array=w43) -> (reversed array=w44)
        Complex Conjugate(x + iy=w44) -> w45
        Replace Array Subset(inArray=w42, index=w12, new=w45) -> w46
        # 17%
        call "Inverse Real FFT.gvi"(FFT{x}=w46) -> (x=w47)
        Multiply(w11, w47) -> w48
        Add(w1, w48) -> w49
        Array Subset(array=w49, length0=w8) -> w50
        $"Data Chunk out" <- w50
        Replace Array Subset(inArray=w49, index=_, new=w10) -> w51
        Rotate 1D Array(array=w51, n=w7) -> (array (last n elements first)=w52)
        $"Waveform Graph" <- s6
        next s1 = w24
        next s2 = w36
        next s3 = w19
        next s4 = w52
        next s5 = w4
        stop if TRUE
      }
    }
  }
  $Error_2 <- $Error
