vi "Pitch Change (Sound Card).gvi"   [Next Generation LabVIEW Features 0.1.0]
# This VI plays a sound file continuously, reading the sound file in pieces, and playing each piece at a time.
# Instructions:
# 1.  Specify the path of a valid WAV file in the Path.
# 2.  Specify the Device ID and # of samples per iteration, if necessary.
# 3.  Run this VI
# 4.  Use the volume knob to dynamically change the volume
panel controls:
  "# of samples per iteration": i32 = 16384
  "stop": bool
  "Frame size": i32 = 2048
  "Overlap": i32 = 16
  "Knob": f64
  "Waveform Constant": waveform<f64> = {dt=2.272e-05, Y=[0.263304206521, 0.168583853956, 0.058864400009, -0.0087342897823, -0.0149667930964, 0.076329107098, 0.114409017457, 0.103176813682, 0.149612387824, 0.0945471937084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]}
  "Audio Sample": waveform<f64> = {dt=0.1, Y=[]}
types:
  "Sound Data Format.gtype" = cluster{"sample rate (S/s)": f64, "number of channels": i32, "bits per sample": i32}
diagram:
  w1 = $"# of samples per iteration"
  w2 = $"Waveform Constant"
  w3 = "Sound Data Format.gtype" {"sample rate (S/s)"=44000, "number of channels"=2, "bits per sample"=16}
  call "Sound Output Configure.gvi"(sound format=w3, number of samples/ch=w1) -> (task ID=w4, error out=w5)
  s1 = w5  # shift register
  s2 = w4  # shift register
  s3 = 0  # shift register
  while {
    Add(s3, w1) -> w6
    Property Node(instance in=w2) -> ("Y"=w7, "dt"=w8)
    Array Subset(array=w7, index0=s3, length0=w1) -> w9
    Build Waveform Node(Y=w9, dt=w8) -> (output waveform=w10)
    call "Pitch Change.gvi"(Waveform in=w10, Frame size=$"Frame size", Overlap=$Overlap, PitchRatio=$Knob) -> (Waveform out=w11)
    Build Array(w11) -> w12
    call "Sound Output Write.gvi"(task ID in=s2, data=w12, error in=s1) -> (task ID out=w13, error out=w14)
    Property Node(instance in=w14) -> ("status"=w15, instance out=w16)
    Logical Or(w15, $stop) -> w17
    next s1 = w16
    next s2 = w13
    next s3 = w6
    stop if w17
  }
