vi "Pitch Change.gvi"   [Next Generation LabVIEW Features 0.1.0]
inputs:
  "Waveform in": waveform<f64> = {dt=1, Y=[]}
  "Frame size": i32 = 2048
  "Overlap": i32 = 32
  "Reset": bool
  "PitchRatio": f64 = 1
outputs:
  "Array of Waveform": waveform<f64>[]
  "Waveform out": waveform<f64>
diagram:
  s1 = uninitialised  # shift register
  while {
    Divide(x=4, y=$Overlap) -> w1
    Quotient And Remainder(x=$"Frame size", y=$Overlap) -> (floor(x/y)=w2)
    Is First Call() -> w3
    Logical Or($Reset, w3) -> w4
    Property Node(instance in=$"Waveform in") -> ("Y"=w5)
    Array Size(array=w5) -> (size(s)=w6)
    case (w4) {
      frame False, Default {
        w7 = s1
      }
      frame True {
        Initialize Array(element=0, size=w6) -> w7
      }
    }
    Quotient And Remainder(x=w6, y=w2) -> (floor(x/y)=w8)
    Reshape Array(inArray=w5, size=w8, size=w2) -> w9
    s2 = w7  # shift register
    s3 = 0  # shift register
    for {
      w10 = each element of w9
      call "Keynote Pitch Change - Process Data Chunk 02b (Windows).gvi"(Data Chunk in=w10, Frame size=$"Frame size", Overlap=$Overlap, Reset=w4, PitchRatio=$PitchRatio) -> (Data Chunk out=w11)
      Replace Array Subset(inArray=s2, index=s3, new=w11) -> w12
      Add(s3, w2) -> w13
      next s2 = w12
      next s3 = w13
    }
    Multiply(s2, w1) -> w14
    Property Node(instance in=$"Waveform in", "Y"=w14) -> (instance out=w15)
    next s1 = w14
    stop if TRUE
  }
  $"Waveform out" <- w15
  Build Array(w15) -> w16
  $"Array of Waveform" <- w16
