vi "Read Audio Port.gvi"   [Next Generation LabVIEW Features 0.1.0]
inputs:
  "error in": error
  "Number of Samples": i32 = 1024
outputs:
  "data": waveform<f64>
  "Error": error
diagram:
  case ($"error in") {
    frame Error {
      w1 = default
      w2 = $"error in"
    }
    frame No Error {
      s1 = uninitialised  # shift register
      while {
        Is First Call() -> w3
        case (w3) {
          frame False, Default {
            w4 = s1
            w5 = $"error in"
            w6 = $"Number of Samples"
          }
          frame True {
            call "DAQmx Create Task.gvi"(error in=$"error in") -> (error out=w7, task out=w8)
            call "DAQmx Create Channel (AI-Voltage-Basic).gvi"(error in=w7, task in=w8, physical channels="myDAQ1/audioInputLeft", maximum value=2, minimum value=-2) -> (error out=w9, task out=w10)
            Multiply(2, $"Number of Samples") -> w11
            call "DAQmx Timing (Sample Clock).gvi"(error in=w9, task in=w10, rate=44100, sample mode="Continuous Samples"(10123), samples per channel=w11) -> (error out=w12, task out=w13)
            call "DAQmx Start Task.gvi"(error in=w12, task in=w13) -> (error out=w5, task out=w4)
            w6 = $"Number of Samples"
          }
        }
        call "DAQmx Read (Analog Wfm 1Chan NSamp).gvi"(error in=w5, task in=w4, number of samples per channel=w6) -> (error out=w2, task out=w14, data=w1)
        next s1 = w14
        stop if TRUE
      }
    }
  }
  $data <- w1
  $Error <- w2
