vi "Finished Ex.gvi"   [Next Generation LabVIEW Features 0.1.0]
panel controls:
  "Slider": f64
  "Remote": bool
  "Stop": bool
panel indicators:
  "Graph": waveform<f64>
  "Intensity Graph": f64[][]
  "Meter": i32
uses:
  NI::Analysis::Measurement::STFT Spectrogram.gvi
diagram:
  call "DAQmx Create Task.gvi"() -> (task out=w1)
  call "DAQmx Create Channel (AI-Voltage-Basic).gvi"(task in=w1, physical channels="myDAQ1/audioInputLeft", maximum value=2, minimum value=-2) -> (task out=w2)
  call "DAQmx Timing (Sample Clock).gvi"(task in=w2, rate=22050, sample mode="Continuous Samples"(10123), samples per channel=2048) -> (task out=w3)
  call "DAQmx Start Task.gvi"(task in=w3) -> (task out=w4)
  while {
    call "DAQmx Read (Analog Wfm 1Chan NSamp).gvi"(task in=w4, number of samples per channel=2048) -> (task out=w5, data=w6)
    call "Modulate Audio.gvi"(set pitch=$Slider, Audio Sample=w6) -> (Waveform=w7)
    $Graph <- w7
    call "Sound output.gvi"(Waveform Constant=w7) -> (data_2=w8)
    call "STFT Spectrogram.gvi"(x=w8) -> (STFT spectrogram=w9)
    $"Intensity Graph" <- w9
    stop if $Stop
  }
  call "DAQmx Stop Task.gvi"(task in=w5)
  disable {
    frame Enabled { }
    frame Disabled {
      call "Init tag write.gvi"() -> (niTag.niTag=w10)
      call "init Tag Read.gvi"() -> (niTag.niTag=w11)
      while {
        case ($Remote) {
          frame False, Default { }
          frame True {
            call "Read Tags.gvi"(tag reference in=w11) -> (Pitch Ratio=w12, Responses=w13)
            $Meter <- w13
            $Slider <- w12
          }
        }
        call "Write Waveform Tag.gvi"(Waveform=$Graph, Write Task=w10)
        stop if $Stop
      }
    }
  }
