vi "Finished Example.gvi"   [Next Generation LabVIEW Features 0.1.0]
panel controls:
  "Boolean": bool
  "Slider": f64
panel indicators:
  "Intensity Graph": f64[][]
  "Graph": waveform<f64>
uses:
  NI::Analysis::Measurement::STFT Spectrogram.gvi
diagram:
  call "DAQmx Create Task.gvi"() -> (error out=w1, task out=w2)
  call "DAQmx Create Channel (AI-Voltage-Basic).gvi"(error in=w1, task in=w2, physical channels="cDAQ1Mod3/ai0", maximum value=2, minimum value=-2) -> (error out=w3, task out=w4)
  call "DAQmx Timing (Sample Clock).gvi"(error in=w3, task in=w4, rate=51200, sample mode="Continuous Samples"(10123), samples per channel=1024) -> (error out=w5, task out=w6)
  call "DAQmx Start Task.gvi"(error in=w5, task in=w6) -> (task out=w7)
  Obtain Queue(element data type=waveform<f64> {dt=1, Y=[]}) -> (queue out=w8)
  while {
    call "DAQmx Read (Analog Wfm 1Chan NSamp).gvi"(task in=w7, number of samples per channel=1024) -> (task out=w9, data=w10)
    call "Modulate Audio.gvi"(set pitch=$Slider, Audio Sample=w10) -> (Waveform=w11)
    call "Sound output.gvi"(Waveform Constant=w11) -> (Clipped waveform=w12)
    $Graph <- w12
    Enqueue Element(element=w10, queue=w8) -> (queue out=w13)
    stop if $Boolean
  }
  call "DAQmx Stop Task.gvi"(task in=w9)
  Release Queue(queue=w13)
  while {
    Dequeue Element(queue=w8) -> (element=w14, error out=w15)
    call "STFT Spectrogram.gvi"(x=w14) -> (STFT spectrogram=w16)
    $"Intensity Graph" <- w16
    stop if w15
  }
