vi "Keynote Dashboard.gvi"   [Next Generation LabVIEW Features 0.1.0]
panel controls:
  "stop": bool
  "Shift Tone": bool
  "Pitch Frequency": f64 = 1
  "Shift Tone_2": bool
  "Volume": f64 = 1
panel indicators:
  "Graph": waveform<f64>
  "Responses": i32
  "Intensity Graph": f64[][]
  "error out": error
  "number pending remove": i32
  "error out_2": error
types:
  T1 = cluster{"time steps": i32, "frequency bins": i32}
uses:
  NI::Analysis::Measurement::STFT Spectrogram.gvi
diagram:
  Obtain Queue(element data type=waveform<f64> {dt=1, Y=[]}) -> (queue out=w1)
  while {
    call "Read Audio Port.gvi"(Number of Samples=1024) -> (data=w2)
    Waveform Multiply(w2, $Volume) -> w3
    Enqueue Element(element=w3, queue=w1)
    stop if $stop
  }
  Initialize Array(element=0, size=1024) -> w4
  call "DAQmx Create Task.gvi"() -> (task out=w5)
  call "DAQmx Create Channel (AO-Voltage-Basic).gvi"(task in=w5, physical channels="cDAQ4Mod4/ao0", maximum value=2, minimum value=-2) -> (task out=w6)
  call "DAQmx Timing (Sample Clock).gvi"(task in=w6, rate=51200, sample mode="Continuous Samples"(10123), samples per channel=100000) -> (task out=w7)
  Property Node(instance in=w7, "RegenMode_1453"="Do Not Allow Regeneration"(10158)) -> (instance out=w8)
  call "DAQmx Write (Analog 1D DBL 1Chan NSamp).gvi"(task in=w8, data=w4) -> (task out=w9)
  call "DAQmx Start Task.gvi"(task in=w9) -> (task out=w10)
  while {
    Dequeue Element(queue=w1) -> (element=w11, queue out=w12)
    case ($"Shift Tone") {
      frame False, Default {
        Build Array(w11) -> w14
        w13 = w11
      }
      frame True {
        call "Modulate Audio.gvi"(set pitch=$"Pitch Frequency", Audio Sample=w11, Slice Set=1024) -> (Waveform=w13, data=w15)
      }
    }
    $Graph <- w13
    call "STFT Spectrogram.gvi"(x=w13, time-frequency sampling information=T1 {"time steps"=-1, "frequency bins"=512}) -> (STFT spectrogram=w16)
    $"Intensity Graph" <- w16
    call "DAQmx Write (Analog 1D DBL 1Chan NSamp).gvi"(task in=w10, data=w13) -> (error out=w17, task out=w18)
    $"error out_2" <- w17
    stop if $stop
  }
  Release Queue(queue=w12)
  call "DAQmx Stop Task.gvi"(task in=w18)
  while {
    Get Queue Status(queue=w1) -> (# pending remove=w19, error out=w20)
    $"number pending remove" <- w19
    Wait(time to wait=1000)
    stop if w20
  }
  disable {
    frame Enabled { }
    frame Disabled {
      call "init Tag Read.gvi"() -> (niTag.niTag=w21)
      call "Init tag write.gvi"() -> (niTag.niTag=w22)
      while {
        case ($"Shift Tone_2") {
          frame False, Default { }
          frame True {
            case ($"Shift Tone") {
              frame False, Default { }
              frame True {
                call "Read Tags.gvi"(tag reference in=w21) -> (Responses=w23)
                $Responses <- w23
              }
            }
            call "Write Waveform Tag.gvi"(Waveform=$Graph, Write Task=w22)
          }
        }
        stop if $stop
      }
    }
  }
