vi "Remote Control.gvi"   [Next Generation LabVIEW Features 0.1.0]
panel controls:
  "stop": bool
  "Tone": f64
  "Remote": bool
panel indicators:
  "Intensity Graph": f64[][]
  "Graph": waveform<f64>
  "Responses": i32
  "error out": error
uses:
  NI::Analysis::Measurement::STFT Spectrogram.gvi
diagram:
  Obtain Queue(element data type=waveform<f64> {dt=1, Y=[]}, max queue size=1) -> (queue out=w1)
  Obtain Queue(element data type=waveform<f64> {dt=1, Y=[]}, max queue size=1) -> (queue out=w2)
  call "DAQmx Create Task.gvi"() -> (error out=w3, task out=w4)
  call "DAQmx Create Channel (AI-Voltage-Basic).gvi"(error in=w3, task in=w4, physical channels="cDAQ2Mod5/ai0", maximum value=2, minimum value=-2) -> (error out=w5, task out=w6)
  call "DAQmx Timing (Sample Clock).gvi"(error in=w5, task in=w6, rate=51200, sample mode="Continuous Samples"(10123), samples per channel=1024) -> (error out=w7, task out=w8)
  call "DAQmx Start Task.gvi"(error in=w7, task in=w8) -> (error out=w9, task out=w10)
  while {
    call "DAQmx Read (Analog Wfm 1Chan NSamp).gvi"(error in=w9, task in=w10, number of samples per channel=1024) -> (error out=w11, task out=w12, data=w13)
    call "Modulate Audio.gvi"(set pitch=$Tone, Audio Sample=w13, Error=w11) -> (Waveform=w14, error in=w15)
    call "Sound output.gvi"(Waveform Constant=w14, Error In=w15) -> (Clipped waveform=w16, Error Out=w17)
    $Graph <- w16
    Logical Or(w17, $stop) -> w18
    Lossy Enqueue Element(element=w14, queue=w1) -> (queue out=w19)
    Lossy Enqueue Element(element=w14, queue=w2) -> (queue out=w20)
    stop if w18
  }
  call "DAQmx Stop Task.gvi"(error in=w17, task in=w12) -> (error out=w21)
  $"error out" <- w21
  Release Queue(queue=w19)
  Release Queue(queue=w20)
  while {
    Dequeue Element(queue=w1) -> (element=w22, error out=w23)
    call "STFT Spectrogram.gvi"(x=w22) -> (STFT spectrogram=w24)
    $"Intensity Graph" <- w24
    Wait(time to wait=20)
    stop if w23
  }
  while {
    Wait(time to wait=100)
    Dequeue Element(queue=w2) -> (element=w25, error out=w26)
    call "Write Waveform Tag.gvi"(Waveform=w25, error in=w26) -> (Error=w27)
    case ($Remote) {
      frame False, Default { }
      frame True {
        call "Read Tags.gvi"(error in=w26) -> (Pitch Ratio=w28, Responses=w29)
        $Responses <- w29
        $Tone <- w28
      }
    }
    stop if w27
  }
