vi "Scale Pitch.gvi"   [Next Generation LabVIEW Features 0.1.0]
inputs:
  "set pitch": f64
outputs:
  "Numeric": f64
diagram:
  Multiply(0.1, $"set pitch") -> w1
  Add(0.7, w1) -> w2
  $Numeric <- w2
