vi "Slice waveform.gvi"   [Next Generation LabVIEW Features 0.1.0]
inputs:
  "Waveform": waveform<f64> = {dt=1, Y=[]}
  "Slice Set": i32 = 1024
  "Error": error
outputs:
  "Waveform_2": waveform<f64>
  "Error_2": error
  "Last Sample": bool
diagram:
  # Given a static file input, this will return a rolling subset of a given window size.
  #
  # When the last valid sample is returned, it will return a true for last sample. Calling this VI
  # again will yield a segment that is smaller than the window
  s1 = uninitialised  # shift register
  while {
    Multiply($"Slice Set", 2) -> w1
    Is First Call() -> w2
    Select(s=w2, t=0, f=s1) -> w3
    Property Node(instance in=$Waveform) -> ("Y"=w4, "dt"=w5)
    Array Size(array=w4) -> (size(s)=w6)
    Subtract(x=w6, y=w3) -> w7
    Is Less(x=w7, y=w1) -> w8
    Array Subset(array=w4, index0=w3, length0=$"Slice Set") -> w9
    Build Waveform Node(Y=w9, dt=w5) -> (output waveform=w10)
    Add(w3, $"Slice Set") -> w11
    next s1 = w11
    stop if TRUE
  }
  $"Last Sample" <- w8
  $Waveform_2 <- w10
  # this is derermined by examining if after the most recent cut, there is enough
  # data for this return and the next, hence hte window size is multipled by 2
  $Error_2 <- $Error
