vi "Init tag write.gvi"   [Next Generation LabVIEW Features 0.1.0]
inputs:
  "error in": error
outputs:
  "niTag.niTag": "niTag"
  "error out": error
diagram:
  call "Open Tag.gvi"(tag path="waveform", error in=$"error in") -> (tag reference out=w1, error out=w2)
  call "Create Tag (String).gvi"(tag reference in=w1, error in=w2) -> (tag reference out=w3, error out=w4)
  $"niTag.niTag" <- w3
  $"error out" <- w4
