vi "Read Tags.gvi"   [Next Generation LabVIEW Features 0.1.0]
inputs:
  "error in": error
outputs:
  "High": f64
  "Low": f64
  "Pitch Ratio": f64
  "Responses": i32
diagram:
  s1 = uninitialised  # shift register
  s2 = $"error in"  # shift register
  while {
    case (s2) {
      frame Error {
        call "Close Tag (Single).gvi"(tag reference=s1)
        w1 = default
        w2 = s2
      }
      frame No Error {
        Is First Call() -> w3
        case (w3) {
          frame False, Default {
            w4 = s1
          }
          frame True {
            call "init Tag Read.gvi"() -> (niTag.niTag=w4)
          }
        }
        call "Read Double Values.gvi"(tag reference in=w4, error in=s2) -> (tag reference out=w1, error out=w2, aggregate values=w5)
        Property Node(instance in=w5) -> ("mean"=w6, "count"=w7, "max"=w8, "min"=w9)
        Multiply(5, w6) -> w10
        $"Pitch Ratio" <- w10
        $Responses <- w7
        $High <- w8
        $Low <- w9
      }
    }
    next s1 = w1
    next s2 = w2
    stop if TRUE
  }
