vi "Write Waveform Tag.gvi"   [Next Generation LabVIEW Features 0.1.0]
inputs:
  "Waveform": waveform<f64> = {dt=0.1, Y=[]}
  "error in": error
outputs:
  "Error": error
panel indicators:
  "Weaveform": f64[]  # Returns the output signal formatted as dynamic data.
uses:
  NI::Analysis::Resampling::Decimate (single shot, DBL).gvi
diagram:
  s1 = uninitialised  # shift register
  s2 = $"error in"  # shift register
  while {
    case (s2) {
      frame Error {
        call "Close Tag (Single).gvi"(tag reference=s1)
        w1 = default
        w2 = s2
      }
      frame No Error {
        Property Node(instance in=$Waveform) -> ("Y"=w3)
        call "Decimate (single shot, DBL).gvi"(input array=w3, decimating factor=10, error in=s2) -> (decimated array=w4, error out=w2)
        $Weaveform <- w4
        Is First Call() -> w5
        case (w5) {
          frame False, Default {
            w1 = s1
          }
          frame True {
            call "Init tag write.gvi"() -> (niTag.niTag=w1)
          }
        }
        Flatten To JSON(anything=w4) -> (JSON string=w6, error out=w7)
        call "Write (String).gvi"(tag reference in=w1, error in=w7, string=w6)
      }
    }
    next s1 = w1
    next s2 = w2
    stop if TRUE
  }
  $Error <- s2
