vi "Update Tags.gvi"   [Next Generation LabVIEW Features 0.1.0]
inputs:
  "Waveform": waveform<f64> = {dt=0.1, Y=[]}
outputs:
  "High": f64
  "Low": f64
  "Pitch Ratio": f64
  "Responses": f64
diagram:
  s1 = uninitialised  # shift register
  s2 = uninitialised  # shift register
  while {
    Is First Call() -> w1
    Select(s=w1, t=0, f=s1) -> w2
    Random Number() -> (number (0 to 1)=w3)
    Multiply(w3, 2) -> w4
    Add(w4, w2) -> w5
    Select(s=w1, t=0, f=s2) -> w6
    Random Number() -> (number (0 to 1)=w7)
    Multiply(w7, 2) -> w8
    Add(w6, w8) -> w9
    Add(w5, w9) -> w10
    Is Greater(x=w5, y=w9) -> w11
    Select(s=w11, t=1.5, f=0.8) -> w12
    Reciprocal(x=w12) -> w13
    next s1 = w5
    next s2 = w9
    stop if TRUE
  }
  $Responses <- w10
  $High <- s1
  $"Pitch Ratio" <- w13
  $Low <- s2
