vi "Vocoder OLD.gvi"   [Next Generation LabVIEW Features 0.1.0]
inputs:
  "Modulation Scheme": bool
  "set pitch": f64
  "Waveform_2": waveform<f64> = {dt=1, Y=[]}
  "Error": error
  "Window": i32 = 2048
  "Overlap": i32 = 32
outputs:
  "x": f64[]
  "data": waveform<f64>[]
  "error in": error
diagram:
  Is Less Or Equal To 0(x=$"set pitch") -> w1
  Select(s=$"Modulation Scheme", t=1.5, f=0.8) -> w2
  Select(s=w1, t=w2, f=$"set pitch") -> w3
  call "Pitch Change.gvi"(Waveform in=$Waveform_2, Frame size=$Window, Overlap=$Overlap, PitchRatio=w3) -> (Array of Waveform=w4, Waveform out=w5)
  $data <- w4
  $x <- w5
  $"error in" <- $Error
