vi "Pitch Change.gvi"   [Next Generation LabVIEW Features 0.1.0]
inputs:
  "Waveform in": waveform<f64> = {dt=1, Y=[]}
  "Frame size": i32 = 2048
  "Overlap": i32 = 16
  "Reset": bool
  "PitchRatio": f64 = 1
outputs:
  "Array of Waveform": waveform<f64>[]
  "Waveform out": waveform<f64>
diagram:
  s1 = uninitialised  # shift register
  while {
    Divide(x=4, y=$Overlap) -> w1
    Quotient And Remainder(x=$"Frame size", y=$Overlap) -> (floor(x/y)=w2)
    Is First Call() -> w3
    Logical Or($Reset, w3) -> w4
    Property Node(instance in=$"Waveform in") -> ("Y"=w5)
    Array Size(array=w5) -> (size(s)=w6)
    case (w4) {
      frame False, Default {
        w7 = s1
      }
      frame True {
        Initialize Array(element=0, size=w6) -> w7
      }
    }
    call "Scale Pitch.gvi"(set pitch=$PitchRatio) -> (Numeric=w8)
    Quotient And Remainder(x=w6, y=w2) -> (floor(x/y)=w9)
    Reshape Array(inArray=w5, size=w9, size=w2) -> w10
    s2 = w7  # shift register
    s3 = 0  # shift register
    for {
      w11 = each element of w10
      call "Keynote Pitch Change - Process Data Chunk 02b (Windows).gvi"(Data Chunk in=w11, Frame size=$"Frame size", Overlap=$Overlap, Reset=w4, PitchRatio=w8) -> (Data Chunk out=w12)
      Replace Array Subset(inArray=s2, index=s3, new=w12) -> w13
      Add(s3, w2) -> w14
      next s2 = w13
      next s3 = w14
    }
    Multiply(s2, w1) -> w15
    Property Node(instance in=$"Waveform in", "Y"=w15) -> (instance out=w16)
    next s1 = w15
    stop if TRUE
  }
  $"Waveform out" <- w16
  Build Array(w16) -> w17
  $"Array of Waveform" <- w17
