vi "Slice waveform.gvi"   [Next Generation LabVIEW Features 0.1.0]
inputs:
  "Waveform": waveform<f64> = {dt=1, Y=[]}
  "Slice Set": i32 = 1024
  "Error": error
  "reset?": bool
outputs:
  "Waveform_2": waveform<f64>
  "Error_2": error
  "Last Sample": bool
diagram:
  # Given a static file input, this will return a rolling subset of a given window size.
  #
  # When the last valid sample is returned, it will return a true for last sample. Calling this VI
  # again will yield a segment that is smaller than the window
  s1 = uninitialised  # shift register
  while {
    Multiply($"Slice Set", 2) -> w1
    Is First Call() -> w2
    Logical Or($"reset?", w2) -> w3
    Select(s=w3, t=0, f=s1) -> w4
    Property Node(instance in=$Waveform) -> ("Y"=w5, "dt"=w6)
    Array Size(array=w5) -> (size(s)=w7)
    Subtract(x=w7, y=w4) -> w8
    Is Less(x=w8, y=w1) -> w9
    Array Subset(array=w5, index0=w4, length0=$"Slice Set") -> w10
    Build Waveform Node(Y=w10, dt=w6) -> (output waveform=w11)
    Add(w4, $"Slice Set") -> w12
    next s1 = w12
    stop if TRUE
  }
  $"Last Sample" <- w9
  $Waveform_2 <- w11
  # this is derermined by examining if after the most recent cut, there is enough
  # data for this return and the next, hence hte window size is multipled by 2
  $Error_2 <- $Error
