vi "Vocoder OLD.gvi"   [Next Generation LabVIEW Features 0.1.0]
inputs:
  "set pitch": f64
  "Waveform_2": waveform<f64> = {dt=1, Y=[]}
  "Error": error
  "Window": i32 = 2048
  "Overlap": i32 = 32
outputs:
  "Waveform out": waveform<f64>
  "data": waveform<f64>[]
  "error in": error
diagram:
  Is First Call() -> w1
  call "Pitch Change.gvi"(Waveform in=$Waveform_2, Frame size=$Window, Overlap=$Overlap, Reset=w1, PitchRatio=$"set pitch") -> (Array of Waveform=w2, Waveform out=w3)
  $"Waveform out" <- w3
  $data <- w2
  $"error in" <- $Error
