vi "Write Waveform Tag.gvi"   [Next Generation LabVIEW Features 0.1.0]
inputs:
  "Waveform": waveform<f64> = {dt=0.1, Y=[]}
  "Write Task": "niTag"
panel indicators:
  "Weaveform": f64[]  # Returns the output signal formatted as dynamic data.
uses:
  NI::Analysis::Resampling::Decimate (single shot, DBL).gvi
diagram:
  call "Decimate (single shot, DBL).gvi"(input array=$Waveform, decimating factor=10) -> (decimated array=w1)
  Flatten To JSON(anything=w1) -> (JSON string=w2, error out=w3)
  call "Write String Tag.gvi"(tag reference in=$"Write Task", error in=w3, string=w2)
  $Weaveform <- w1
