vi "init Tag Read.gvi"   [Next Generation LabVIEW Features 0.1.0]
outputs:
  "niTag.niTag": "niTag"
diagram:
  call "Open Tag.gvi"(tag path="modulation") -> (tag reference out=w1, error out=w2)
  Property Node(instance in=w1, "Collect Aggregates_4"=TRUE, error in=w2) -> (error out=w3, instance out=w4)
  call "Create Tag (Double).gvi"(tag reference in=w4, error in=w3) -> (tag reference out=w5, error out=w6)
  call "Write Double Tag.gvi"(tag reference in=w5, error in=w6, double=1) -> (tag reference out=w7)
  call "Reset Aggregates (Single).gvi"(tag reference in=w7) -> (tag reference out=w8)
  $"niTag.niTag" <- w8
