vi "Editor Demo.gvi"   [Next Generation LabVIEW Features 0.1.0]
panel controls:
  "Boolean": bool
panel indicators:
  "Graph": waveform<f64>
  "Intensity Graph": f64[][]
uses:
  NI::Analysis::Measurement::STFT Spectrogram.gvi
diagram:
  call "DAQmx Create Task.gvi"() -> (error out=w1, task out=w2)
  call "DAQmx Create Channel (AI-Voltage-Basic).gvi"(error in=w1, task in=w2, physical channels="myDAQ1/audioInputLeft", maximum value=2, minimum value=-2) -> (error out=w3, task out=w4)
  call "DAQmx Timing (Sample Clock).gvi"(error in=w3, task in=w4, rate=22050, sample mode="Continuous Samples"(10123), samples per channel=2048) -> (error out=w5, task out=w6)
  call "DAQmx Start Task.gvi"(error in=w5, task in=w6) -> (task out=w7)
  while {
    call "DAQmx Read (Analog Wfm 1Chan NSamp).gvi"(task in=w7, number of samples per channel=2048) -> (task out=w8, data=w9)
    call "Modulate Audio.gvi"(Audio Sample=w9) -> (Waveform=w10, Last Sample?=w11)
    call "Sound output.gvi"(Waveform Constant=w10) -> (data_2=w12)
    $Graph <- w12
    call "STFT Spectrogram.gvi"(x=w12) -> (STFT spectrogram=w13)
    $"Intensity Graph" <- w13
    Logical Or(w11, $Boolean) -> w14
    stop if w14
  }
  call "DAQmx Stop Task.gvi"(task in=w8)
