vi "Function_2.gvi"   [Next Generation LabVIEW Features 0.1.0]
panel indicators:
  "data": waveform<f64>[]
  "data_2": waveform<f64>[]
diagram:
  call "DAQmx Read (Analog 1D Wfm NChan NSamp Duration).gvi"(task in="Analog Input_2", duration=5) -> (data=w1)
  $data <- w1
  call "DAQmx Read (Analog 1D Wfm NChan NSamp Duration).gvi"(task in="Analog Input", duration=5) -> (data=w2)
  $data_2 <- w2
