vi "Function_4.gvi"   [Next Generation LabVIEW Features 0.1.0]
panel controls:
  "Boolean": bool
  "Slider": f64
panel indicators:
  "Graph": waveform<f64>[]
  "Intensity Graph": f64[][]
types:
  "Sound Data Format.gtype" = cluster{"sample rate (S/s)": f64, "number of channels": i32, "bits per sample": i32}
uses:
  NI::Analysis::Measurement::STFT Spectrogram.gvi
diagram:
  w1 = "Sound Data Format.gtype" {"sample rate (S/s)"=44000, "number of channels"=2, "bits per sample"=16}
  call "Sound Output Configure.gvi"(sound format=w1, number of samples/ch=1024) -> (task ID=w2)
  call "Sound Output Start.gvi"(task ID in=w2) -> (task ID out=w3)
  while {
    w4 = waveform<f64> {dt=2.272e-05, Y=[0.263304206521, 0.168583853956, 0.058864400009, -0.0087342897823, -0.0149667930964, 0.076329107098, 0.114409017457, 0.103176813682, 0.149612387824, 0.0945471937084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]}
    call "Modulate Audio.gvi"(set pitch=$Slider, Audio Sample=w4) -> (Waveform=w5, data=w6, B1=w7)
    call "STFT Spectrogram.gvi"(x=w5) -> (STFT spectrogram=w8)
    $"Intensity Graph" <- w8
    $Graph <- w6
    call "Sound Output Write.gvi"(task ID in=w3, data=w6) -> (task ID out=w9)
    Logical Or(w7, $Boolean) -> w10
    stop if w10
  }
  call "Sound Output Stop.gvi"(task ID in=w9)
