vi "Function_6.gvi"   [Next Generation LabVIEW Features 0.1.0]
diagram:
  call "Sound Output Configure.gvi"() -> (task ID=w1)
  call "Sound Output Start.gvi"(task ID in=w1) -> (task ID out=w2)
  while {
    call "Read Audio Port.gvi"() -> (data=w3)
    call "Modulate Audio.gvi"(Audio Sample=w3) -> (data=w4)
    call "Sound Output Write.gvi"(task ID in=w2, data=w4) -> (task ID out=w5)
    stop if _
  }
  call "Sound Output Stop.gvi"(task ID in=w5)
