vi "Keynote Dashboard_No Tags.gvi"   [Next Generation LabVIEW Features 0.1.0]
panel controls:
  "stop": bool
  "Shift Tone": bool
  "Remote Cntrl": bool
  "Slider": f64 = 1
  "Reset": bool
panel indicators:
  "Graph": waveform<f64>
  "Responses": i32
  "Intensity Graph": f64[][]
types:
  "Sound Data Format.gtype" = cluster{"sample rate (S/s)": f64, "number of channels": i32, "bits per sample": i32}
uses:
  NI::Analysis::Measurement::STFT Spectrogram.gvi
diagram:
  Obtain Queue(element data type=waveform<f64> {dt=1, Y=[]}) -> (queue out=w1)
  while {
    call "Read Audio Port.gvi"(Number of Samples=1024) -> (data=w2)
    Enqueue Element(element=w2, queue=w1)
    stop if $stop
  }
  w3 = "Sound Data Format.gtype" {"sample rate (S/s)"=22050, "number of channels"=1, "bits per sample"=16}
  call "Sound Output Configure.gvi"(sound format=w3, number of samples/ch=1024) -> (task ID=w4)
  call "Sound Output Start.gvi"(task ID in=w4) -> (task ID out=w5)
  s1 = w5  # shift register
  while {
    Dequeue Element(queue=w1) -> (element=w6)
    case ($"Shift Tone") {
      frame False, Default {
        Build Array(w6) -> w7
        w8 = w6
      }
      frame True {
        call "Modulate Audio.gvi"(set pitch=$Slider, Audio Sample=w6, Slice Set=1024) -> (Waveform=w8, data=w7)
      }
    }
    $Graph <- w8
    call "STFT Spectrogram.gvi"(x=w8) -> (STFT spectrogram=w9)
    $"Intensity Graph" <- w9
    call "Sound Output Write.gvi"(task ID in=s1, data=w7) -> (task ID out=w10)
    next s1 = w10
    stop if $stop
  }
  call "Sound Output Stop.gvi"(task ID in=s1)
  call "init Tag Read.gvi"() -> (niTag.niTag=w11)
  call "Init tag write.gvi"() -> (niTag.niTag=w12)
  while {
    case ($"Remote Cntrl") {
      frame False, Default { }
      frame True {
        case ($"Shift Tone") {
          frame False, Default { }
          frame True {
            call "Read Tags.gvi"(tag reference in=w11) -> (Pitch Ratio=w13, Responses=w14)
            $Responses <- w14
            $Slider <- w13
          }
        }
        call "Write Waveform Tag.gvi"(Waveform=$Graph, Write Task=w12)
      }
    }
    stop if $stop
  }
