vi "Modulate Audio.gvi"   [Next Generation LabVIEW Features 0.1.0]
inputs:
  "set pitch": f64 = 5
  "Audio Sample": waveform<f64> = {dt=0.1, Y=[]}, required
  "Error": error
  "Slice Set": i32 = 2048
outputs:
  "Waveform": waveform<f64>
  "data": waveform<f64>[]
  "error in": error
  "Last Sample?": bool
diagram:
  case (TRUE) {
    frame True {
      call "Pitch Change.gvi"(Waveform in=$"Audio Sample", Frame size=$"Slice Set", Overlap=32, PitchRatio=$"set pitch") -> (Array of Waveform=w2, Waveform out=w1)
      w3 = $Error
      w4 = FALSE
    }
    frame False {
      call "Slice waveform.gvi"(Waveform=$"Audio Sample", Slice Set=$"Slice Set", Error=$Error) -> (Waveform_2=w5, Error_2=w6, Last Sample=w4)
      call "Vocoder OLD.gvi"(set pitch=$"set pitch", Waveform_2=w5, Error=w6, Window=$"Slice Set") -> (Waveform out=w1, data=w2, error in=w3)
    }
  }
  $Waveform <- w1
  $data <- w2
  $"Last Sample?" <- w4
  Property Node(instance in=$"Audio Sample") -> ("attributes"=w7)
  Variant To Data(type=string "Live", variant=w7) -> (data=w8)
  Is Equal(x=w8, y=string "Live")
  $"error in" <- w3
