vi "Read Audio Port.gvi"   [Next Generation LabVIEW Features 0.1.0]
inputs:
  "error in": error
  "Number of Samples": i32 = 1024
outputs:
  "data": waveform<f64>
  "Error": error
diagram:
  case ($"error in") {
    frame Error {
      w1 = default
      w2 = $"error in"
      w3 = $"Number of Samples"
    }
    frame No Error {
      s1 = uninitialised  # shift register
      while {
        Is First Call() -> w4
        case (w4) {
          frame False, Default {
            w5 = s1
            w6 = $"error in"
            w3 = $"Number of Samples"
          }
          frame True {
            call "DAQmx Create Task.gvi"(error in=$"error in") -> (error out=w7, task out=w8)
            call "DAQmx Create Channel (AI-Voltage-Basic).gvi"(error in=w7, task in=w8, physical channels="myDAQ1/audioInputLeft", maximum value=2, minimum value=-2) -> (error out=w9, task out=w10)
            Multiply(2, $"Number of Samples") -> w11
            call "DAQmx Timing (Sample Clock).gvi"(error in=w9, task in=w10, rate=22050, sample mode="Continuous Samples"(10123), samples per channel=w11) -> (error out=w12, task out=w13)
            call "DAQmx Start Task.gvi"(error in=w12, task in=w13) -> (error out=w6, task out=w5)
            w3 = $"Number of Samples"
          }
        }
        call "DAQmx Read (Analog Wfm 1Chan NSamp).gvi"(error in=w6, task in=w5, number of samples per channel=w3, timeout=0.5) -> (error out=w2, task out=w14, data=w1)
        next s1 = w14
        stop if TRUE
      }
    }
  }
  # The code is writen this way to keep the diagram people are likely to see during the keynote as clean as possile. The singleiteration while oops are used to store previous values so that the session wire isn't on the calling VI
  #
  # In addition, if the DAQ driver doesn't initiatlize properly, a recorded data set in the second loop can still be played.
  s2 = uninitialised  # shift register
  s3 = w2  # shift register
  while {
    Is First Call() -> w15
    Select(s=w15, t=FALSE, f=s2) -> w16
    case (s3) {
      frame No Error, Default {
        w17 = w1
        w18 = s3
        w19 = default
      }
      frame Error {
        w20 = waveform<f64> {dt=2.267e-05, Y=[0.0152368768104, 0.0152368768104, 0.0148944315733, 0.0153738549052, 0.0153053658578, 0.0154423439526, 0.0153738549052, 0.0153053658578, 0.015510833, 0.0148944315733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]}
        call "Slice waveform.gvi"(Waveform=w20, Slice Set=w3, reset?=w16) -> (Waveform_2=w17, Last Sample=w19)
        call "Clear Error Cluster.gvi"(error in=s3) -> (error out=w18)
      }
    }
    next s2 = w19
    next s3 = w18
    stop if TRUE
  }
  $Error <- s3
  Property Node(instance in=w17, "attributes"="Live") -> (instance out=w21)
  $data <- w21
