vi "Sound output.gvi"   [Next Generation LabVIEW Features 0.1.0]
inputs:
  "Waveform Constant": waveform<f64> = {dt=0.1, Y=[]}
  "Volume": f64 = 10
  "Error In": error
outputs:
  "Clipped waveform": waveform<f64>
  "Error Out": error
diagram:
  Waveform Multiply($"Waveform Constant", $Volume) -> w1
  Waveform In Range And Coerce(lower limit=-4, upper limit=4, x=w1) -> w2
  $"Clipped waveform" <- w2
  # Prevents a waveform
  # from exceeding the limits
  # of the AO card
  s1 = uninitialised  # shift register
  s2 = $"Error In"  # shift register
  while {
    Is First Call() -> w3
    case (w3) {
      frame False, Default {
        w4 = s1
        w5 = s2
      }
      frame True {
        # only runs the first call
        call "DAQmx Create Task.gvi"(error in=s2) -> (error out=w6, task out=w7)
        call "DAQmx Create Channel (AO-Voltage-Basic).gvi"(error in=w6, task in=w7, physical channels="cDAQ2Mod6/ao0", maximum value=4, minimum value=-4) -> (error out=w8, task out=w9)
        call "DAQmx Timing (Sample Clock).gvi"(error in=w8, task in=w9, rate=51200, sample mode="Continuous Samples"(10123), samples per channel=100000) -> (error out=w10, task out=w11)
        Property Node(instance in=w11, "RegenMode_1453"="Do Not Allow Regeneration"(10158), error in=w10) -> (error out=w12, instance out=w13)
        Initialize Array(element=0, size=1024) -> w14
        call "DAQmx Write (Analog 1D DBL 1Chan NSamp).gvi"(error in=w12, task in=w13, data=w14) -> (error out=w15, task out=w16)
        call "DAQmx Start Task.gvi"(error in=w15, task in=w16) -> (error out=w5, task out=w4)
      }
    }
    call "DAQmx Write (Analog Wfm 1Chan NSamp).gvi"(error in=w5, task in=w4, data=w2) -> (error out=w17, task out=w18)
    next s1 = w18
    next s2 = w17
    stop if TRUE
  }
  $"Error Out" <- s2
