vi "Vocoder OLD.gvi"   [Next Generation LabVIEW Features 0.1.0]
inputs:
  "Modulation Scheme": bool
  "set pitch": f64
  "Waveform_2": waveform<f64> = {dt=1, Y=[]}
  "Error": error
outputs:
  "x": f64[]
  "data": waveform<f64>[]
  "error in": error
diagram:
  Is Less Or Equal To 0(x=$"set pitch") -> w1
  Select(s=$"Modulation Scheme", t=1.5, f=0.8) -> w2
  Select(s=w1, t=w2, f=$"set pitch") -> w3
  call "Pitch Change.gvi"(Waveform in=$Waveform_2, Frame size=2048, Overlap=32, PitchRatio=w3) -> (Waveform out=w4)
  Build Array(w4) -> w5
  $data <- w5
  $x <- w4
  $"error in" <- $Error
